# Grasshopper definition RhinoGrasshopper_001.gh (Grasshopper 1.0.7)

number_slider = Slider(0.23, range=-1..1)
negative = Negative(Value=number_slider)
construct_domain = ConstructDomain(DomainStart=negative, DomainEnd=number_slider)
range = Range(Domain=construct_domain, Steps=Slider(6, range=0..10))
radius = Radius(Slider(1, range=0..1))
panel = Panel(range)
panel_2 = Panel(radius)
circle = Circle(Plane=PlaneXY(0, 0, 0), Radius=radius)
merge = Merge(Data2=range)
merge_2 = Merge(Data1=Slider(0, range=0..1), Data3=Slider(0.5, range=0..1))
param_viewer = ParamViewer(circle)
panel_3 = Panel(circle)
evaluate_curve = EvaluateCurve(Curve=reparameterize(circle), Parameter=merge)  # -> Point, Tangent, Angle
evaluate_curve_2 = EvaluateCurve(Curve=reparameterize(circle), Parameter=merge_2)  # -> Point, Tangent, Angle
dispatch = Dispatch(List=flatten(evaluate_curve_2.Point), DispatchPattern=[True, False])  # -> ListA, ListB
panel_4 = Panel(evaluate_curve.Point)
point = Point(graft(evaluate_curve.Point))
point_2 = Point(dispatch.ListB)
point_3 = Point(dispatch.ListA)
line = Line(StartPoint=point, EndPoint=point_3)
line_2 = Line(StartPoint=point, EndPoint=point_2)
line_3 = Line(StartPoint=point_3, EndPoint=point_2)
panel_5 = Panel(point)
