# Grasshopper definition RhinoGrasshopper_002.gh (Grasshopper 1.0.7)

number_slider = Slider(6, range=1..9)
# The School of Number
# Leani about mathematics with 40 simple lesson
# written by Emily Hawkins
# illustrated by Daniel Frost
# 
# creative coding in grasshopper by
# Michael Wickerson
# LESSON ONE:
# What are Digits?
panel = Panel("10")
range = Range(Domain=panel, Steps=number_slider)
construct_point = ConstructPoint(XCoordinate=range, YCoordinate=0, ZCoordinate=0)  # -> flatten(Point)
series = Series(Start="1", Step=1, Count=number_slider)  # -> graft(Series)
entwine = Entwine(Branch00=series, Branch01="0", FlattenInputs=True)  # -> graft(Result)
division = Division(A=panel, B=number_slider)
jitter = Jitter(List=flatten(entwine), Jitter=1, Seed=Slider(71361, range=0..100000))  # -> Values, Indices
text_tag_3d = TextTag3D(Location=construct_point, Text=jitter.Values, Size=division, Justification=7)
panel_2 = Panel(jitter.Values)
circle = Circle(Plane=construct_point, Radius=jitter.Values)
evaluate_curve = EvaluateCurve(
    Curve=reparameterize(circle),
    Parameter=graft([Slider(0, range=0..1), Slider(0.24, range=0..1), Slider(0.5, range=0..1)]))  # -> Point, Tangent, Angle
explode_tree = ExplodeTree(Data=evaluate_curve.Point)  # -> Branch0, Branch1, Branch2
line = Line(StartPoint=explode_tree.Branch0, EndPoint=explode_tree.Branch1)
line_2 = Line(StartPoint=explode_tree.Branch0, EndPoint=explode_tree.Branch2)
line_3 = Line(StartPoint=explode_tree.Branch1, EndPoint=explode_tree.Branch2)
join_curves = JoinCurves(Curves=[line, line_2, line_3], Preserve=False)
boundary_surfaces = BoundarySurfaces(Edges=flatten(join_curves))
