# Grasshopper definition RhinoGrasshopper_003.gh (Grasshopper 1.0.7)
# plug-ins: Kangaroo2 Components

# ----
# Title: Double Helix
# Parameter
# Sliders
height = Slider(5, range=0..5)
divided_count = Slider(14, range=0..20)
subd_thickness = Slider(0.27, range=0..2)

# ----
# oscillation
# engine
trigger = Trigger(Interval=20, TimerInterval=20, Target=data_recorder)
data_recorder = DataRecorder("1", DataLimit=10000, RecordData=False)
list_length = ListLength(List=data_recorder)
division = Division(A=list_length, B=Slider(55, range=0..100))
sine = Sine(Value=division)
multiplication = Multiplication(A=height, B=sine)
panel = Panel(sine)

absolute = Absolute(Value=multiplication)

# ----
# Point Generation
pi = Pi(Factor=absolute)
construct_domain = ConstructDomain(DomainStart=0, DomainEnd=pi)
range = Range(Domain=construct_domain, Steps="100")
cosine = Cosine(Value=range)
sine_2 = Sine(Value=range)
construct_point = ConstructPoint(XCoordinate=cosine, YCoordinate=sine_2, ZCoordinate=range)
geometry = Geometry(construct_point)

# ----
# Curve Generation
interpolate = Interpolate(Vertices=geometry, Degree=3, Periodic=False, KnotStyle=1)  # -> Curve, Length, Domain
center = Center(Point(0, 0, 0))
axis = Axis(Vector(0, 0, 1))
pi_2 = Pi(Factor="1")
rotate_3d = Rotate3D(Geometry=interpolate.Curve, Angle=pi_2, Center=center, Axis=axis)  # -> Geometry, Transform
vector_display = VectorDisplay(Anchor=axis, Vector=axis)
divide_curve = DivideCurve(Curve=interpolate.Curve, Count=divided_count, Kinks=False)  # -> Points, Tangents, Parameters
divide_curve_2 = DivideCurve(Curve=rotate_3d.Geometry, Count=divided_count, Kinks=False)  # -> Points, Tangents, Parameters
line = Line(StartPoint=divide_curve.Points, EndPoint=divide_curve_2.Points)
merge = Merge(Data1=interpolate.Curve, Data2=rotate_3d.Geometry, Data3=line)

# ----
# SubD Generation
number_slider = Slider(1, range=0..2)
multipipe = MultiPipe(Curves=merge, NodeSize=subd_thickness, EndOffset=1, StrutSize=1, Segment=0, KinkAngle=0.6, CubeFit=0, Caps=number_slider)

# ----
# Panel
# and
# Param Viewer
param_viewer = ParamViewer(geometry)
panel_2 = Panel(geometry)
